# Dynamo graph 1-IO-Exceptions.dyn (Dynamo 2.0.1.5055)

string = StringInput("")
throwExceptionIfStringIsNull = DynamoWorkshop.ZeroTouch.Exceptions.ThrowExceptionIfStringIsNull(text=string)
watch = Watch(throwExceptionIfStringIsNull)
code_block = CodeBlock()
# ---------- code_block.designscript (10 lines) ----------
[
1,
2,
3,
null,
0,
3,
null,
1
];
# ----------------------------------------
handleListNullExceptionsInternally = DynamoWorkshop.ZeroTouch.Exceptions.HandleListNullExceptionsInternally(list=code_block)
watch_2 = Watch(handleListNullExceptionsInternally)
